# Grasshopper definition GTides-Bake.gh (Grasshopper 1.0.8)

# ---- group: 1. parse input / link CSV here
# Module 3: GTides-Bake
# A data processing solution that creates point clouds from CSV data generated by XBeach and XArray.
# GTides-Bake converts data extracted from XBeach in previous steps to points. Once data has been converted to points, it is ready for geometric or visual manipulation.
# Most of what this script does is process data to get it into a format suitable for Rhino. The CSV files generated by XBeach are very large, making it difficult to work with them in real time.
# This script utilizes multiple stages of clipping, culling, and subsampling to deal with this issue. The resulting group of points can be manipulated through parameters relatively performantly,
# allowing a user to visualize (and even animate) the same transect at multiple points in time.
# Color Key
# container
# safe to change values
# Parameter Groups: Green groups represent user-specified parameters. Per-step documentation will cover what each one does. For now, just remember that these values allow you to refine the script. You can (and should!) play with them.
# Parameters
# 
# "File":
# Link your CSV here by right-clicking on the
# component and setting a file path. This is the data
#  that the script will process.
file = File("C:\Users\juice\PycharmProjects\Computational-Design\NetCDF-test-files\output-Simresults.csv")

# ---- group: 2. prepare data / default delimiter
# Parameters
# 
# None
panel = Panel(",")

# ---- group: 3. cut out unwanted data and restore structure / enter index of first invalid row
nan_value_index = Slider(416242, range=0..1000000)

# ---- group: 3. cut out unwanted data and restore structure / number of data columns (default is 37)
# Parameters
# 
# "NaN Value Index":
# Input the first NaN index of your CSV here.
number_of_data_columns = Slider(37, range=0..100)

# ---- group: lower data boundary
# Parameters
# 
# "Upper Data Boundary"
# Upper limit of Z-displacement data. All values exceeding this will be removed.
# 
# "Lower Data Boundary"
# Lower limit of Z-displacement data. All values less than this will be removed.
number_slider = Slider(0.01, range=1e-05..0.01)

# ---- group: 4. filter data by time step / location of macro time steps (hours)
# Parameters
# 
# "Macro Step Interval":
# Input the desired macro-scale time step.
# 
# "Micro Step Interval":
# Input the desired micro-scale time step.
global_time_step_column = Panel("2")

# ---- group: 5. saubsample data / default x-coord location
nx = Panel("1")

# ---- group: 5. saubsample data / default y-coord location
ny = Panel("0")

# ---- group: 5. saubsample data / default delta-z location
# Parameters
# 
# "Valid Factors" (READ-ONLY):
# Valid factors to be use to reduce data resolution.
# 
# "Factor Index":
# Select subsampling factor based on position within list of valid factors.
# 
# "Selected Factor" (READ-ONLY):
# Output current subsampling factor.
zs = Panel("29")

# ---- group: 1. parse input
# Procedure Groups: Blue groups represent individual stages of the script. This creates an organizational structure to improve user experience. Procedure groups are a parent object, containing processing components(i.e. "Text Split", "List Item"), user-specified parameters, and user-editable default values.
# do not change values
# unless necessary
# Default Groups: Yellow groups represent default values. These are data inputs that might have to change if the input data changes, but should generally be left alone. Do not change these values unless you are familiar with your data and the script.
# This network parses a user-specified CSV file
# as a list. This parsing step is important, because
# it creates the data structure needed in subsequent
# steps.
# 1
read_file = ReadFile(File=file, PerLineParse=True)

# ---- group: 4. filter data by time step / select macro time step
macro_step_interval = Slider(0, range=0..120, expression="(x*300)")

# ---- group: 2. prepare data / default header data mask
panel_2 = Panel("{0;0;0}")

# ---- group: 2. prepare data
# 2
text_split = TextSplit(Text=read_file, Separators=panel)
# This network performs basic CSV processing
# tasks to further refine the data structure. Text is split
# into branches of a data tree by a delimiting character,
# and the header is cropped out of the data set using a
# data mask.
split_tree = SplitTree(Data=text_split, Masks=flatten(panel_2))  # -> Positive, flatten(Negative)

# ---- group: 3. cut out unwanted data and restore structure
# 3
multiplication = Multiplication(A=nan_value_index, B=number_of_data_columns)
split_list = SplitList(List=split_tree.Negative, Index=multiplication)  # -> ListA, ListB
# Our XBeach-based approach currently has a bug
# which causes it to populate an additional
# simulation time period's worth of null values in
# exported data tables. When plot in Matlab, these
# null values are discarded. In Grasshopper, this
# must be done manually. To accomplish this task,
# a user supplies the CSV row number of the first
# NaN value, clipping out all others. Additionally,
# values go through their last step of data
# restructuring, where they are grouped into their
# original rows.
partition_list = PartitionList(List=split_list.ListA, Size=number_of_data_columns)

# ---- group: 4. filter data by time step / location of micro time steps (30 sec)
micro_time_step_column = Panel("4")

# ---- group: 4. filter data by time step / select micro time step
micro_step_interval = Slider(3600, range=3600..36000)

# ---- group: 4. filter data by time step
# 4
i = Index(global_time_step_column)
item = ListItem(List=partition_list, Index=i, Wrap=True)
B = SecondNumber(macro_step_interval)
equals = Equality(FirstNumber=item, SecondNumber=B)  # -> Equality, Inequality
cull = CullPattern(List=partition_list, CullPattern=equals.Equality)
clean = CleanTree(RemoveNulls=True, RemoveInvalid=True, RemoveEmpty=True, Tree=cull)
i_2 = Index(micro_time_step_column)
item_2 = ListItem(List=clean, Index=i_2, Wrap=True)
B_2 = SecondNumber(micro_step_interval)
equals_2 = Equality(FirstNumber=item_2, SecondNumber=B_2)  # -> Equality, Inequality
cull_2 = CullPattern(List=clean, CullPattern=equals_2.Equality)
# This network filters data by time step. This allows
# the user to view wave attenuation data for a single
# snapshot in time. Selection parameters for macro
# and micro time steps allow users to page through
# different snapshots in a simple and efficient way.
clean_2 = CleanTree(RemoveNulls=True, RemoveInvalid=True, RemoveEmpty=True, Tree=cull_2)

# ---- group: 5. saubsample data / default delimiter
panel_3 = Panel(",")

# ---- group: 5. saubsample data / remove brackets from factor list
panel_4 = Panel("""[
]""")

# ---- group: 5. saubsample data / remove spaces from factor list
panel_5 = Panel(" ")

# ---- group: 5. saubsample data / factor index
number_slider_2 = Slider(4, range=0..29)

# ---- group: 5. saubsample data
# 5
integer = Integer(nx)
integer_2 = Integer(ny)
integer_3 = Integer(zs)
list_item = ListItem(List=clean_2, Index=integer, Wrap=True)
list_item_2 = ListItem(List=clean_2, Index=integer_2, Wrap=True)
list_item_3 = ListItem(List=clean_2, Index=integer_3, Wrap=True)
list_length = ListLength(List=flatten(list_item))
integer_4 = Integer(list_length)
subsampling_factors = Python3Script(input_list_length=integer_4)  # -> out
# ---------- subsampling_factors: Python ----------
from functools import reduce
from math import sqrt

#define input variable
x = input_list_length

#define function to determine factors
def factors(x):
    step = 2 if x%2 else 1
    return set(reduce(list.__add__,
    ([i, x//i] for i in range(1, int(sqrt(x))+1, step) if x % i == 0)))

#call function
factors_of_list_leng = factors(x)

#cull repeat data
factors_culled = set(factors_of_list_leng)

#sort from greatest to least factor - this means resolution defaults to lowest and can be increased. this makes it easier for the user to open the application, determine params, and only get a high-quality result when ready.
factors_list = list(factors_culled)
factors_sorted = sorted(factors_list, reverse=True)

#output
out = factors_sorted

print(out)
# ---------- end subsampling_factors ----------

# ---- group: 5. saubsample data / valid factors
subsampling_factors_2 = Panel(subsampling_factors)

# ---- group: 5. saubsample data (continued)
text_split_2 = TextSplit(Text=subsampling_factors_2, Separators=panel_3)
replace_text = ReplaceText(Text=text_split_2, Find=panel_4, RecursiveReplace=False)
replace_text_2 = ReplaceText(Text=replace_text, Find=panel_5, RecursiveReplace=False)
create_set = CreateSet(List=replace_text_2)  # -> Set, Map
list_item_4 = ListItem(List=create_set.Set, Index=number_slider_2, Wrap=True)
partition_list_2 = PartitionList(List=flatten(list_item_2), Size=list_item_4)
partition_list_3 = PartitionList(List=flatten(list_item_3), Size=list_item_4)
partition_list_4 = PartitionList(List=flatten(list_item), Size=list_item_4)
mass_addition = MassAddition(Input=partition_list_2)  # -> Result, PartialResults
mass_addition_2 = MassAddition(Input=partition_list_3)  # -> Result, PartialResults
mass_addition_3 = MassAddition(Input=partition_list_4)  # -> Result, PartialResults
calculate_subsample_percent = Python3Script(subsampling_factor=list_item_4, list_length=list_length)  # -> out, out_float, out_pct
# ---------- calculate_subsample_percent: Python ----------
#percent reduction calculator#

#define variables
part = int(subsampling_factor)
whole = int(list_length)

#calculate percentage
percent = (100 * (part / whole))

#print result
out_pct = (str(percent) + '%')
#print(str(out_pct) + '%')

out_float = percent
print(out_float)
# ---------- end calculate_subsample_percent ----------
list_length_2 = ListLength(List=partition_list_2)
list_length_3 = ListLength(List=partition_list_3)
list_length_4 = ListLength(List=partition_list_4)
division = Division(A=mass_addition.Result, B=list_length_2)  # -> flatten(Result)
division_2 = Division(A=mass_addition_2.Result, B=list_length_3)
division_3 = Division(A=mass_addition_3.Result, B=list_length_4)  # -> flatten(Result)
# After data is filtered by time step, it is subsampled.
# This subsampling is conducted by grouping
# values to uniformly divide the list of data. A user
# can determine valid subsampling factors (the
# values with which to divide the data set) through a
# custom Python component. The mean of each
# group is taken, reducing the resolution of the data
# while retaining accuracy.
subsampled_data_resolution = Panel(calculate_subsample_percent.out_pct)

# ----
# 6
smaller = SmallerThan(FirstNumber=division_2, SecondNumber=number_slider)  # -> SmallerThan, OrEqualTo
cull_3 = CullPattern(List=division_2, CullPattern=smaller.OrEqualTo)
clean_3 = CleanTree(RemoveNulls=True, RemoveInvalid=True, RemoveEmpty=True, Tree=cull_3)
larger = LargerThan(FirstNumber=clean_3, SecondNumber=Slider(-0.0001, range=-0.1..-0.0001))  # -> LargerThan, OrEqualTo
cull_4 = CullPattern(List=clean_3, CullPattern=larger.OrEqualTo)
clean_4 = CleanTree(RemoveNulls=True, RemoveInvalid=True, RemoveEmpty=True, Tree=cull_4)
panel_6 = Panel(clean_4)
list = ValueList({"landfall": 0, "no landfall": 1}, selected="no landfall")
filter = StreamFilter(Gate=list, Stream0=division_2, Stream1=panel_6)
multiplication_2 = Multiplication(A=filter, B=Slider(982015, range=0..1000000))  # -> flatten(Result)
lng = ListLength(List=multiplication_2)
split = SplitList(List=division_3, Index=expr("x - 1", lng))  # -> ListA, ListB
split_2 = SplitList(List=division, Index=expr("x - 1", lng))  # -> ListA, ListB
# After the previous data processing steps, points
# can be constructed. Users can optionally engage
# a final filtering step to deal with an elevation spike
# that occurs at the point in a simulation where a
# wave makes landfall.
construct_point = ConstructPoint(XCoordinate=split.ListA, YCoordinate=split_2.ListA, ZCoordinate=multiplication_2)

# ---- group: 7. bake output
nurbs = NurbsCurve(Vertices=construct_point, Degree=3, Periodic=False)  # -> Curve, Length, Domain
pt = Point(construct_point)
# Geometry can be baked from this container.
# Users can choose between points or a NURBS curve.
geo = Geometry(pt)
geo_2 = Geometry(nurbs.Curve)

# ---- group: 5. saubsample data / selected factor
panel_7 = Panel(list_item_4)
